# Grasshopper definition STRETCHER PROJECTION.gh (Grasshopper 1.0.7)

point_size = Slider(50, range=0..100)
min_projection = Slider(50, range=0..100)
pt = ConstructPoint(XCoordinate=0, YCoordinate=0, ZCoordinate=0)
max_projection = Slider(150, range=0..1000)
# ATTRACTOR CURVE
crv = Curve(<curve referenced from the Rhino model>)
# ATTRACTOR POINT
pt_2 = Point(<point referenced from the Rhino model>)
# LINE SHIFTER
toggle = BooleanToggle(True)
pt_3 = Point(pt)
base_length = Slider(2400, range=0..10000)
mortor_thickness = Slider(10, range=0..10)
length = Slider(190, range=0..1000)
width = Slider(90, range=0..100)
height = Slider(90, range=0..100)
steps_of_bricks = Slider(36, range=0..100)

X = UnitX(Factor=base_length)
move = Move(Geometry=pt_3, Motion=X)  # -> Geometry, Transform
addition = Addition(A=mortor_thickness, B=height)
series = Series(Start=0, Step=addition, Count=steps_of_bricks)
ln = Line(StartPoint=pt_3, EndPoint=move.Geometry)
Z = UnitZ(Factor=series)
move_2 = Move(Geometry=ln, Motion=Z)  # -> Geometry, Transform
merge = Merge(Data1=toggle, Data2=Toggle(False))
dispatch = Dispatch(List=move_2.Geometry, DispatchPattern=merge)  # -> ListA, ListB

addition_2 = Addition(A=length, B=mortor_thickness)
addition_3 = Addition(A=width, B=mortor_thickness)
crv_2 = Curve(dispatch.ListA)
addition_4 = Addition(A=addition_2, B=addition_3)
divlength = DivideLength(Curve=crv_2, Length=addition_4)  # -> Points, Tangents, Parameters
addition_5 = Addition(A=width, B=mortor_thickness)
addition_6 = Addition(A=length)
X_2 = UnitX(Factor=addition_5)
X_3 = UnitX(Factor=addition_6)
X_4 = UnitX(Factor=width)
move_3 = Move(Geometry=divlength.Points, Motion=X_2)  # -> Geometry, Transform
move_4 = Move(Geometry=move_3.Geometry, Motion=X_3)  # -> Geometry, Transform
move_5 = Move(Geometry=divlength.Points, Motion=X_4)  # -> Geometry, Transform
ln_2 = Line(StartPoint=divlength.Points, EndPoint=move_5.Geometry)
Z_2 = UnitZ(Factor=width)
ln_3 = Line(StartPoint=move_3.Geometry, EndPoint=move_4.Geometry)
extr = Extrude(Base=ln_2, Direction=Z_2)
Y = UnitY(Factor=length)
extr_2 = Extrude(Base=ln_3, Direction=Z_2)
Y_2 = UnitY(Factor=length)
X_5 = UnitX(Factor=Slider(50, range=0..100))
extr_3 = Extrude(Base=extr, Direction=Y)
extr_4 = Extrude(Base=extr_2, Direction=Y_2)
move_6 = Move(Geometry=extr_3, Motion=X_5)  # -> Geometry, Transform
move_7 = Move(Geometry=extr_4, Motion=X_5)  # -> Geometry, Transform

addition_7 = Addition(A=length, B=mortor_thickness)
addition_8 = Addition(A=width, B=mortor_thickness)
crv_3 = Curve(dispatch.ListB)
addition_9 = Addition(A=addition_7, B=addition_8)
divlength_2 = DivideLength(Curve=crv_3, Length=addition_9)  # -> Points, Tangents, Parameters
addition_10 = Addition(A=width)
addition_11 = Addition(A=length, B=mortor_thickness)
X_6 = UnitX(Factor=addition_11)
X_7 = UnitX(Factor=addition_10)
X_8 = UnitX(Factor=length)
move_8 = Move(Geometry=divlength_2.Points, Motion=X_6)  # -> Geometry, Transform
move_9 = Move(Geometry=move_8.Geometry, Motion=X_7)  # -> Geometry, Transform
move_10 = Move(Geometry=divlength_2.Points, Motion=X_8)  # -> Geometry, Transform
ln_4 = Line(StartPoint=divlength_2.Points, EndPoint=move_10.Geometry)
Z_3 = UnitZ(Factor=width)
ln_5 = Line(StartPoint=move_8.Geometry, EndPoint=move_9.Geometry)
extr_5 = Extrude(Base=ln_4, Direction=Z_3)
Y_3 = UnitY(Factor=width)
extr_6 = Extrude(Base=ln_5, Direction=Z_3)
Y_4 = UnitY(Factor=length)
extr_7 = Extrude(Base=extr_5, Direction=Y_3)
extr_8 = Extrude(Base=extr_6, Direction=Y_4)

merge_2 = Merge(Data1=extr_7, Data2=move_7.Geometry)
merge_3 = Merge(Data1=extr_8, Data2=move_6.Geometry)  # -> simplify(flatten(Result))
area = Area(Geometry=merge_3)  # -> Area, Centroid

lng = ListLength(List=area.Centroid)
panel = Panel(lng)
crv_cp = CurveClosestPoint(Point=area.Centroid, Curve=crv)  # -> Point, Parameter, Distance
dist = Distance(PointA=area.Centroid, PointB=pt_2)

remap = Remap(data=dist, min=min_projection, max=max_projection)
Y_5 = UnitY(Factor=remap)

move_11 = Move(Geometry=merge_3, Motion=expr("-x", Y_5))  # -> Geometry, Transform
area_2 = Area(Geometry=move_11.Geometry)  # -> Area, Centroid
merge_4 = Merge(Data1=merge_2, Data2=move_11.Geometry)
move_12 = Move(Geometry=area_2.Centroid, Motion=expr("-x", Y_5))  # -> Geometry, Transform
dist_2 = Distance(PointA=area_2.Centroid, PointB=area.Centroid)
# DISTANCE CHART
panel_2 = Panel(dist_2)
panel_3 = Panel(dist_2)
points = PointList(Points=move_12.Geometry, Size=point_size)

# ==== cluster Remap: Remaps numbers
data = ClusterInput()
min = ClusterInput()
max = ClusterInput()
bnd = Bounds(Numbers=data)
dom = ConstructDomain(DomainStart=min, DomainEnd=max)
remap = RemapNumbers(Value=data, Source=bnd, Target=dom)  # -> Mapped, Clipped
R = ClusterOutput(remap.Mapped)
